% Simulink data dictionary paramsDataDictionary.sldd

Param = Simulink.Parameter(0)
altCtrlkd_sPrad = Simulink.Parameter(0, Min=0, Max=100)  % [secPerRad] Altitude controller derivative gain.
altCtrlkp_Prad = Simulink.Parameter(1, Min=0, Max=100)  % [PerRad] Altitude controller proportional gain.
altCtrltau_s = Simulink.Parameter(0.1, Min=0.025, Max=10)  % [sec] Altitude controller time constant.
announceInterval_s = Simulink.Parameter(1, Min=0, Max=5)  % [s] Announce interval for machine 2
botACrsHrWdth_px = Simulink.Parameter(1, Min=0, Max=50)  % [px] Width of crosshair overlay in bottom A image.
botADotPosVec_cm = Simulink.Parameter([2.48 0 -4.53], Min=-20, Max=20)  % [cm] Bottom A dots centroid in body fixed coordinates
botADotSepDist_cm = Simulink.Parameter(2.54, Min=0, Max=10)  % [cm] Bottom A dots separation distance.
botBCrsHrWdth_px = Simulink.Parameter(1, Min=0, Max=50)  % [px] Width of crosshair overlay in bottom A image.
botBDotPosVec_cm = Simulink.Parameter([9.1 0 -4.64], Min=-20, Max=20)  % [cm] Bottom B dots centroid in body fixed coordinates
botBDotSepDist_cm = Simulink.Parameter(3.18, Min=0, Max=10)  % [cm] Bottom B dots separation distance.
botCamEulAng_deg = Simulink.Parameter([0 180 180], Min=-360, Max=360)  % [deg] Bottom camera Euler angles, [Roll Pitch Yaw], rotation order is Z, Y, X.
botCamPosVec_cm = Simulink.Parameter([-27.94 5.08 7.62], Min=-100, Max=100)  % [cm] Bottom camera position vector.
botImageSize_px = Simulink.Parameter([1088 2048], Min=0, Max=2048)  % [px] Size of image from bottom [rows cols].
botVidStrmDec_na = Simulink.Parameter(5, Min=0, Max=50)  % [NA] Bottom camera video stream frame decimation (display every N frames).
botVidStrmImgWdth_px = Simulink.Parameter(1200, Min=0, Max=5000)  % [px] Bottom video stream image width.
botVidStrmsrcSwtch_na = Simulink.Parameter(1, Min=1, Max=2)  % [NA] Bottom video stream source switch.
bottomIPAddress_na = Simulink.Parameter([30 30 30 2], Min=0, Max=1000)  % [NA] Bottom local IP Address
bottomMinDelay_s = Simulink.Parameter(2.5, Min=0, Max=5)  % [s] Bottom minimum delay between request intervals
bottomToPort_na = Simulink.Parameter(8002, Min=8000, Max=9000)  % [NA] Bottom to port address on machine 2
cameraFOV_deg = Simulink.Parameter([30 30], Min=0, Max=60)  % [deg] Camera field of view angles from centerline [horiz vert]
imagProcErrDbncTm_s = Simulink.Parameter(0.1, Min=0, Max=10)  % [s] Image processing error debounce time.
imagProcErrThrsh_na = Simulink.Parameter(0.5, Min=0, Max=10)  % [NA] Image processing error threshold.
initCoMPosVec_cm = Simulink.Parameter([-28 0 35.6], Min=-100, Max=100)  % [cm] Initial center of mass position vector.
manualMotorSpeed_na = Simulink.Parameter(0.25, Min=0, Max=1)  % [na] Manual motor speed command, only used in GUI
maxOutVltg_vlt = Simulink.Parameter(3.3, Min=0, Max=5)  % [V] Maximum analog output voltage.
offsetThreshold_s = Simulink.Parameter(0.00025, Min=1.0e-8, Max=0.01)  % [s] Offset threshold for all machines
operationMode_na = Simulink.Parameter(1, Min=0, Max=1)  % [bool] Control mode: 0 for manual, 1 for automatic
pitchCtrlkd_sPrad = Simulink.Parameter(0, Min=0, Max=100)  % [secPerRad] Pitch controller derivative gain.
pitchCtrlkp_Prad = Simulink.Parameter(1, Min=0, Max=100)  % [PerRad] Pitch controller proportional gain.
pitchCtrltau_s = Simulink.Parameter(0.1, Min=0.025, Max=10)  % [sec] Pitch controller time constant.
roiBotAHldPos_px = Simulink.Parameter([615 1150], Min=0, Max=2048)  % [px] Default image [row col] coordinates of ROI for bottom A camera.
roiBotASize_px = Simulink.Parameter([180 60], Min=0, Max=500)  % [px] Default ROI size [row col] for bottom A camera.
roiBotBHldPos_px = Simulink.Parameter([465 1150], Min=0, Max=2048)  % [px] Default image [row col] coordinates of ROI for bottom B camera.
roiBotBSize_px = Simulink.Parameter([54 162], Min=0, Max=500)  % [px] Default ROI size [row col] for bottom B camera.
roiSideHldPos_px = Simulink.Parameter([730 1050], Min=0, Max=2048)  % [px] Default image [row col] coordinates of ROI for side camera.
roiSideSize_px = Simulink.Parameter([90 270], Min=0, Max=500)  % [px] Default ROI size [row col] for side camera.
roiSlntHldPos_px = Simulink.Parameter([460 1170], Min=0, Max=2048)  % [px] Default image [row col] coordinates of ROI for slant camera.
roiSlntSize_px = Simulink.Parameter([60 180], Min=0, Max=500)  % [px] Default ROI size [row col] for slant camera.
rollCtrlkd_sPrad = Simulink.Parameter(0, Min=0, Max=100)  % [secPerRad] Roll controller derivative gain.
rollCtrlkp_Prad = Simulink.Parameter(1, Min=0, Max=100)  % [PerRad] Roll controller proportional gain.
rollCtrltau_s = Simulink.Parameter(0.1, Min=0.025, Max=10)  % [sec] Roll controller time constant.
sideCamEulAng_deg = Simulink.Parameter([0 90 -90], Min=-360, Max=360)  % [deg] Side camera Euler angles, [Roll Pitch Yaw], rotation order is Z, Y, X.
sideCamPosVec_cm = Simulink.Parameter([-27.94 -20.32 38.1], Min=-100, Max=100)  % [cm] Side camera position vector.
sideCrsHrWdth_px = Simulink.Parameter(1, Min=0, Max=50)  % [px] Width of crosshair overlay i   n side image.
sideDotPosVec_cm = Simulink.Parameter([0.091 -4.54 0.878], Min=-20, Max=20)  % [cm] Position of side dots centroid in body fixed coordinates
sideDotSepDist_cm = Simulink.Parameter(2.54, Min=0, Max=10)  % [cm] Side dots separation distance.
sideIPAddress_na = Simulink.Parameter([30 30 30 1], Min=0, Max=255)  % [NA] Side local IP Address
sideImageSize_px = Simulink.Parameter([1088 2048], Min=0, Max=2048)  % [px] Size of image from side camera [rows cols].
sideMinDelay_s = Simulink.Parameter(2, Min=0, Max=5)  % [s] Side minimum delay between request intervals
sideToPort_na = Simulink.Parameter(8001, Min=8000, Max=9000)  % [NA] Side to port address on machine 2
sideVidStrmDec_na = Simulink.Parameter(5, Min=0, Max=50)  % [NA] Side camera video stream frame decimation (display every N frames).
sideVidStrmImgWdth_px = Simulink.Parameter(1200, Min=0, Max=5000)  % [px] Side video stream image width
slantIPAddress_na = Simulink.Parameter([30 30 30 3], Min=0, Max=1000)  % [NA] Slant local IP Address
slantMinDelay_s = Simulink.Parameter(2.25, Min=0, Max=5)  % [s] Slant minimum delay between request intervals
slantToPort_na = Simulink.Parameter(8003, Min=8000, Max=9000)  % [NA] Slant to port address on machine 2
slntCamEulAng_deg = Simulink.Parameter([0 135 180], Min=-360, Max=360)  % [deg] Slant camera Euler angles, [Roll Pitch Yaw], rotation order is Z, Y, X.
slntCamPosVec_cm = Simulink.Parameter([-53.34 5.08 7.62], Min=-100, Max=100)  % [cm] Slant camera position vector.
slntCrsHrWdth_px = Simulink.Parameter(1, Min=0, Max=50)  % [px] Width of crosshair overlay in slant image.
slntImageSize_px = Simulink.Parameter([1088 2048], Min=0, Max=2048)  % [px] Size of image from slnt camera [rows cols].
slntVidStrmDec_na = Simulink.Parameter(5, Min=0, Max=50)  % [NA] Slant camera video stream frame decimation (display every N frames).
slntVidStrmImgWdth_px = Simulink.Parameter(1200, Min=0, Max=5000)  % [px] Slant video stream image width.
syncInterval_s = Simulink.Parameter(0.2, Min=0.08, Max=1)  % [s] Sync interval for all machines
mtr1ManulaSpdCmd_na = Simulink.Parameter(-0.01333333, Min=-1, Max=1)  % [na] Manual motor 1 speed setting
mtr2ManulaSpdCmd_na = Simulink.Parameter(-0.01333333, Min=-1, Max=1)  % [na] Manual motor 2 speed setting
mtr3ManulaSpdCmd_na = Simulink.Parameter(-0.01333333, Min=-1, Max=1)  % [na] Manual motor 3 speed setting